# Grasshopper definition sun.gh (Grasshopper 1.0.5)
# plug-ins: LunchBox

number_slider = Slider(0, range=0..1)
number_slider_2 = Slider(4, range=1..10)

number_slider_3 = Slider(0, range=0..1)
pt = ConstructPoint(XCoordinate=number_slider_3, YCoordinate=number_slider_3, ZCoordinate=number_slider_3)

xy = XYPlane(Origin=pt)
sph = Sphere(Base=xy, Radius=Slider(1500, range=1000..10000))
subtraction = Subtraction(A=Slider(11, range=1..36), B=number_slider_2)
number_slider_4 = Slider(20, range=20..60)
dup = DuplicateData(Data=number_slider, Number=number_slider_2, Order=True)
dup_2 = DuplicateData(Data=number_slider, Number=subtraction, Order=True)
trib = TrianglePanelsB(Surface=sph, UDivisions=number_slider_4, VDivisions=number_slider_4)
merge = Merge(Data1=flatten(dup), Data2=flatten("1"), Data3=flatten(dup_2))
dispatch = Dispatch(List=trib, DispatchPattern=merge)  # -> ListA, ListB
item = ListItem(List=trib, Index=0, Wrap=True)
clean = CleanTree(RemoveNulls=True, RemoveInvalid=True, RemoveEmpty=False, Tree=trib)
geo = Geometry(graft(clean))

# ---- group: Different Rays
number_slider_5 = Slider(0, range=0..1)  # disabled
number_slider_6 = Slider(11, range=1..36)  # disabled
number_slider_7 = Slider(4, range=1..16)  # disabled
subtraction_2 = Subtraction(A=number_slider_6, B=number_slider_7)  # disabled
dup_3 = DuplicateData(Data=number_slider_5, Number=number_slider_7, Order=True)  # disabled
dup_4 = DuplicateData(Data=number_slider_5, Number=subtraction_2, Order=True)  # disabled
panel = Panel("1")  # disabled
merge_2 = Merge(Data1=flatten(dup_3), Data2=flatten(panel), Data3=flatten(dup_4))  # disabled
panel_2 = Panel("""0
1
1
0""")  # disabled
tstat = TreeStatistics(Tree=geo)  # -> Paths, Length, Count; disabled
dispatch_2 = Dispatch(List=tstat.Paths, DispatchPattern=panel_2)  # -> ListA, ListB; disabled
branch = TreeBranch(Tree=geo, Path=dispatch_2.ListB, MaintainPaths=True)  # disabled
branch_2 = TreeBranch(Tree=geo, Path=dispatch_2.ListA, MaintainPaths=True)  # disabled
dispatch_3 = Dispatch(List=trib, DispatchPattern=merge_2)  # -> ListA, ListB; disabled
clean_2 = CleanTree(RemoveNulls=True, RemoveInvalid=True, RemoveEmpty=False, Tree=dispatch_3.ListA)  # disabled
number_slider_8 = Slider(1.3, range=1..2)  # disabled
geo_2 = Geometry(graft(clean_2))  # disabled
number_slider_9 = Slider(10, range=0..30)  # disabled
number_slider_10 = Slider(1.6, range=1..2)  # disabled
number_slider_11 = Slider(5, range=0..10)  # disabled
cluster = Cluster(origin=pt, origin_3=number_slider_9, origin_2=number_slider_8, relay=branch)  # -> L, V, pt_2, cv, i, item_1, item_2, pl, pl_2, pl_3; disabled
cluster_2 = Cluster(origin=pt, origin_3=number_slider_11, origin_2=number_slider_10, relay=branch_2)  # -> L, V, pt_2, cv, i, item_1, item_2, pl, pl_2, pl_3; disabled
srf = Surface(cluster.pl)  # disabled
srf_2 = Surface(cluster.pl_2)  # disabled
srf_3 = Surface(cluster.pl_3)  # disabled
srf_4 = Surface(cluster_2.pl)  # disabled
srf_5 = Surface(cluster_2.pl_2)  # disabled
srf_6 = Surface(cluster_2.pl_3)  # disabled
pt_2 = Point(cluster.i)  # disabled
pt_3 = Point(cluster.item_2)  # disabled
pt_4 = Point(cluster.pt_2)  # disabled
pt_5 = Point(cluster.item_1)  # disabled

# ----
tstat_2 = TreeStatistics(Tree=geo)  # -> Paths, Length, Count
item_2 = ListItem(List=tstat_2.Paths, Index=0, Wrap=True)
branch_3 = TreeBranch(Tree=geo, Path=item_2, MaintainPaths=True)
cluster_3 = Cluster(origin=pt, origin_3=Slider(5, range=0..10), origin_2=Slider(1.6, range=1..2), relay=geo)  # -> L, V, pt_2, cv, i, item_1, item_2, pl, pl_2, pl_3

# ---- group: Different Rays / Sun
geo_3 = Geometry(dispatch.ListB)  # disabled

# ---- group: Sun
geo_4 = Geometry(dispatch.ListB)

# ----
srf_7 = Surface(cluster_3.pl)
srf_8 = Surface(cluster_3.pl_2)
srf_9 = Surface(cluster_3.pl_3)
vec = Vector(cluster_3.V)
pt_6 = Point(cluster_3.cv)
pt_7 = Point(cluster_3.i)
pt_8 = Point(cluster_3.item_1)
pt_9 = Point(cluster_3.item_2)
line = Line(cluster_3.L)
merge_3 = Merge(Data1=pt_6, Data2=pt_7, Data3=pt_8)
merge_4 = Merge(Data1=pt_6, Data2=pt_8, Data3=pt_9)
merge_5 = Merge(Data1=pt_6, Data2=pt_9, Data3=pt_7)
merge_6 = Merge(Data1=pt_7, Data2=pt_8, Data3=pt_9)
panel_3 = Panel("""1
3""")
panel_4 = Panel("""0
2""")
panel_5 = Panel("""2
0""")
pline = PolyLine(Vertices=merge_4, Closed=False)
pline_2 = PolyLine(Vertices=merge_5, Closed=False)
pline_3 = PolyLine(Vertices=merge_3, Closed=False)
merge_7 = Merge()
pline_4 = PolyLine(Vertices=merge_6, Closed=False)
triangle = MeshTriangle(CornerA=0, CornerB=1, CornerC=2)
conmesh = ConstructMesh(Vertices=merge_5, Faces=triangle)
conmesh_2 = ConstructMesh(Vertices=merge_6, Faces=triangle)
conmesh_3 = ConstructMesh(Vertices=merge_4, Faces=triangle)
conmesh_4 = ConstructMesh(Vertices=merge_3, Faces=triangle)
merge_8 = Merge(Data1=conmesh_4, Data2=conmesh_3, Data3=conmesh)
mesh = Mesh(merge_8)
mjoin = MeshJoin(Meshes=conmesh_2)  # -> flatten(Mesh)
Z = UnitZ(Factor=Slider(13317, range=10000..100000))
mjoin_2 = MeshJoin(Meshes=mesh)
mjoin_3 = MeshJoin(Meshes=mjoin)
panel_6 = Panel(mjoin_2)
unim = UnifyMesh(Mesh=mjoin_3)  # -> Result, Count
move = Move(Geometry=unim.Result, Motion=Z)  # -> Geometry, Transform
mesh_2 = Mesh(move.Geometry)

# ==== cluster Cluster
relay = ClusterInput()
debrep = DeconstructBrep(Brep=relay)  # -> Faces, Edges, Vertices
pcen = PolygonCenter(Polyline=relay)  # -> CenterV, CenterE, CenterA
origin = ClusterInput()
trim = TrimTree(Tree=debrep.Vertices, Depth=1)
vec2pt = Vector2Pt(PointA=origin, PointB=pcen.CenterV, Unitize=False)  # -> Vector, Length
cv = ClusterOutput(pcen.CenterV)
ln = Line(StartPoint=origin, EndPoint=pcen.CenterV)
L = ClusterOutput(ln)
origin_2 = ClusterInput()
origin_3 = ClusterInput()
item = ListItem(List=trim, Index=0, Wrap=True)  # -> Item, Item1, Item2
panel = Panel("""0
1""")
i = ClusterOutput(item.Item)
item_1 = ClusterOutput(item.Item1)
item_2 = ClusterOutput(item.Item2)
multiplication = Multiplication(A=origin_3, B=origin_2)
unit = UnitVector(Vector=vec2pt.Vector)
amp = Amplitude(Vector=unit, Amplitude=origin_3)
move = Move(Geometry=relay, Motion=amp)  # -> Geometry, Transform
tstat = TreeStatistics(Tree=move.Geometry)  # -> Paths, Length, Count
dispatch = Dispatch(List=tstat.Paths, DispatchPattern=panel)  # -> ListA, ListB
branch = TreeBranch(Tree=move.Geometry, Path=dispatch.ListB, MaintainPaths=True)
branch_2 = TreeBranch(Tree=move.Geometry, Path=dispatch.ListA, MaintainPaths=True)
V = ClusterOutput(amp)
amp_2 = Amplitude(Vector=amp, Amplitude=multiplication)
addition = Addition(A=vec2pt.Vector, B=amp_2)
pt = Point(addition)

# ---- group: Off Surface Pyramids
debrep_2 = DeconstructBrep(Brep=move.Geometry)  # -> Faces, Edges, Vertices
trim_2 = TrimTree(Tree=debrep_2.Vertices, Depth=1)
item_3 = ListItem(List=trim_2, Index=0, Wrap=True)  # -> Item, Item1, Item2
merge = Merge(Data1=pt, Data2=item_3.Item2, Data3=item_3.Item, Data4=pt)
merge_2 = Merge(Data1=pt, Data2=item_3.Item1, Data3=item_3.Item2, Data4=pt)
merge_3 = Merge(Data1=pt, Data2=item_3.Item, Data3=item_3.Item1, Data4=pt)
pline = PolyLine(Vertices=merge, Closed=False)
pline_2 = PolyLine(Vertices=merge_2, Closed=False)
pline_3 = PolyLine(Vertices=merge_3, Closed=False)

# ----
pt_2 = ClusterOutput(pt)
pl = ClusterOutput(pline_3)
pl_2 = ClusterOutput(pline_2)
pl_3 = ClusterOutput(pline)
